# Grasshopper definition Object.gh (Grasshopper 1.0.7)
# plug-ins: Pancake

panel_control_ratio = Slider(0.1, range=0..0.5)
panel_thickness = Slider(10, range=5..100)
panel_l1_x = Slider(600, range=300..2000)
panel_l2_y = Slider(600, range=300..2000)
hole_radius = Slider(20, range=5..50)
panel_material = ValueList({"石膏板": 0, "矽酸鈣板": 1, "木絲水泥板": 2, "水泥纖維板": 3}, selected="木絲水泥板")
shop_drawing = BooleanToggle(False)
performance = BooleanToggle(False)
dimensions = BooleanToggle(False)
xy_plane = XYPlane(Origin=Point(0, 0, 0))
custom_ceiling_panel_by_control_ratio = CustomCeilingPanelByControlRatio(
    plane=xy_plane,
    panel_l1_x=panel_l1_x,
    panel_l2_y=panel_l2_y,
    panel_thickness=panel_thickness,
    panel_control_ratio=panel_control_ratio,
    hole_radius=hole_radius,
    panel_material=panel_material,
    shop_drawing=shop_drawing,
    dimensions=dimensions,
    performance=performance)  # -> origin_2, model_2, drawings_3, dimension_3, performance_6
brep = Brep(custom_ceiling_panel_by_control_ratio.model_2)

# ---- group: Export geometry as 3dm
concatenate = Concatenate(Folder="C:\Users\susan\Desktop\Export\", File_Name="Panel", _3dm=".3dm")
file_location = Panel(concatenate)
export_3dm = Export3DM(Geometry=brep, FileLocation=concatenate, Overwrite=False, Version=0, Export=Button())  # -> OK, Log

# ----
geometry = Geometry(custom_ceiling_panel_by_control_ratio.drawings_3)
data = Data(custom_ceiling_panel_by_control_ratio.dimension_3)
data_2 = Data(custom_ceiling_panel_by_control_ratio.performance_6)
dimension = Panel(data)
performance_2 = Panel(data_2)

# ==== cluster CustomCeilingPanelByControlRatio
panel_control_ratio = ClusterInput()
panel_material = ClusterInput()
hole_radius = ClusterInput()
panel_thickness = ClusterInput()
panel_l1_x = ClusterInput()
plane = ClusterInput()
panel_l2_y = ClusterInput()
performance = ClusterInput()
shop_drawing = ClusterInput()
dimensions = ClusterInput()
plane_2 = Plane(plane)
panel_l1_x_2 = Number(panel_l1_x)
panel_l2_y_2 = Number(panel_l2_y)
panel_material_2 = Integer(panel_material)
panel_thickness_2 = Number(panel_thickness)
panel_control_ratio_2 = Number(panel_control_ratio)
performance_2 = Boolean(performance)
hole_radius_2 = Number(hole_radius)
shop_drawing_2 = Boolean(shop_drawing)
dimensions_2 = Boolean(dimensions)
square_root = SquareRoot(Value=panel_control_ratio_2)
multiplication = Multiplication(A=hole_radius_2, B=2)
addition = Addition(A=panel_l1_x_2, B=multiplication)
addition_2 = Addition(A=panel_l2_y_2, B=multiplication)
expression = Expression(Lx=panel_l1_x_2, Ratio=square_root, r=hole_radius_2, Expression="( Lx * Ratio - r ) / ( 2*r )")
expression_2 = Expression(Lx=panel_l2_y_2, Ratio=square_root, r=hole_radius_2, Expression="( Lx * Ratio - r ) / ( 2*r )")
division = Division(A=addition_2, B=2)
division_2 = Division(A=addition, B=2)

division_3 = Division(A=panel_l2_y_2, B=2)
division_4 = Division(A=panel_l1_x_2, B=2)
construct_domain = ConstructDomain(DomainStart=division_4, DomainEnd=expr("x*-1", division_4))
construct_domain_2 = ConstructDomain(DomainStart=division_3, DomainEnd=expr("x*-1", division_3))
rectangle = Rectangle(Plane=plane_2, XSize=construct_domain, YSize=construct_domain_2, Radius=0)  # -> Rectangle, Length
curve = Curve(rectangle.Rectangle)

construct_domain_3 = ConstructDomain(DomainStart=division, DomainEnd=expr("x*-1", division))
construct_domain_4 = ConstructDomain(DomainStart=division_2, DomainEnd=expr("x*-1", division_2))
round = Round(Number=expression_2)  # -> Nearest, Floor, Ceiling
round_2 = Round(Number=expression)  # -> Nearest, Floor, Ceiling
integer = Integer(round_2.Floor)
integer_2 = Integer(round.Floor)
multiplication_2 = Multiplication(A=integer, B=integer_2)
rectangle_2 = Rectangle(Plane=plane_2, XSize=construct_domain_4, YSize=construct_domain_3, Radius=0)  # -> Rectangle, Length
boundary_surfaces = BoundarySurfaces(Edges=rectangle_2.Rectangle)

range = Range(Domain=Domain(0, 1), Steps=expr("x+1", integer))
range_2 = Range(Domain=Domain(0, 1), Steps=expr("x+1", integer_2))
shift_list = ShiftList(List=range_2, Shift="1", Wrap=False)
shift_list_2 = ShiftList(List=shift_list, Shift="-1", Wrap=False)
shift_list_3 = ShiftList(List=range, Shift="1", Wrap=False)
shift_list_4 = ShiftList(List=shift_list_3, Shift="-1", Wrap=False)
cross_reference = CrossReference(ListListA=shift_list_4, ListListB=shift_list_2, CrossMode=1)  # -> flatten(ListListA), flatten(ListListB)
format = Format(Format="{0},{1},0", Culture=127, Data0=cross_reference.ListListA, Data1=cross_reference.ListListB)
boundary_surfaces_2 = BoundarySurfaces(Edges=curve)
concatenate = Concatenate(FragmentA="{", FragmentB=format, FragmentA_2="}")
evaluate_surface = EvaluateSurface(Surface=reparameterize(graft(boundary_surfaces)), Point=concatenate)  # -> Point, Normal, UDirection, VDirection, Frame

performance_3 = Boolean(performance_2)
dimensions_3 = Boolean(dimensions_2)
shop_drawing_3 = Boolean(shop_drawing_2)
boolean = Boolean(performance_3)
integer_3 = Integer(multiplication_2)
number = Number(panel_thickness_2)
curve_2 = Curve(curve)
number_2 = Number(hole_radius_2)
plane_3 = Plane(evaluate_surface.Point)
number_3 = Number(panel_l1_x_2)
number_4 = Number(panel_l2_y_2)
integer_4 = Integer(panel_material_2)
number_5 = Number(panel_l1_x_2)
number_6 = Number(panel_l2_y_2)
integer_5 = Integer(multiplication_2)
integer_6 = Integer(panel_material_2)
stream_filter = StreamFilter(Gate=shop_drawing_3, Stream1=plane_3)
stream_filter_2 = StreamFilter(Gate=shop_drawing_3, Stream1=curve_2)
panel = Panel(stream_filter_2)
stream_filter_3 = StreamFilter(Gate=dimensions_3, Stream1=number_3)
stream_filter_4 = StreamFilter(Gate=dimensions_3, Stream1=number_4)
stream_filter_5 = StreamFilter(Gate=dimensions_3, Stream1=number)
stream_filter_6 = StreamFilter(Gate=dimensions_3, Stream1=integer_3)
stream_filter_7 = StreamFilter(Gate=dimensions_3, Stream1=number_2)
stream_filter_8 = StreamFilter(Gate=performance_3, Stream1=integer_4)
stream_filter_9 = StreamFilter(Gate=boolean, Stream1=integer_6)
stream_filter_10 = StreamFilter(Gate=boolean, Stream1=number_5)
stream_filter_11 = StreamFilter(Gate=boolean, Stream1=integer_5)
stream_filter_12 = StreamFilter(Gate=boolean, Stream1=number_6)
panel_2 = Panel(stream_filter_3)

# ----
# Construction Cost
# 
# Fake Rules:
# area * price per unit + n_holes * price per cut
price_per_cut = Panel("""15
15
30
30""")
number_7 = Number(stream_filter_10)
number_8 = Number(stream_filter_12)
price_per_unit_price_m2 = Panel("""300
500
1400
1000""")
integer_7 = Integer(stream_filter_11)
integer_8 = Integer(stream_filter_9)
number_of_holes = Panel(integer_7)
expression_3 = Expression(x=number_7, y=number_8, Expression="(x*y)/1000000")
area_m2 = Panel(expression_3)
list_item = ListItem(List=price_per_unit_price_m2, Index=integer_8, Wrap=True)
list_item_2 = ListItem(List=price_per_cut, Index=integer_8, Wrap=True)
expression_4 = Expression(V=expression_3, pv=list_item, n=integer_7, pc=list_item_2, Expression="V*pv+n*pc")
cost = Number(expression_4)
cost_2 = Panel(cost)

unit_list = Panel("""mm
mm
m2
m2
m3
m2
%
%""")
graft_tree = GraftTree(Tree=unit_list, IncludeEmptyLists=True, IncludeNullItems=True)
origin = Plane(plane_2)
origin_2 = ClusterOutput(origin)
unit_list_2 = Panel("""kg/m3
kg
kgf/cm2
kgf/cm2
-
W/(m.k)
NTD""")
graft_tree_2 = GraftTree(Tree=unit_list_2, IncludeEmptyLists=True, IncludeNullItems=True)

# ----
# Dimensions
number_9 = Number(stream_filter_3)
number_10 = Number(stream_filter_4)
number_11 = Number(stream_filter_7)
integer_9 = Integer(stream_filter_6)
number_12 = Number(stream_filter_5)
expression_5 = Expression(
    x=number_9,
    y=number_10,
    z=number_12,
    r=number_11,
    n=integer_9,
    Expression="( 2 * (x*y+y*z+z*x) + (2*π*r*z*n) - (2*π*r²*n) ) / 1000000")
expression_6 = Expression(r=number_11, n=integer_9, Expression="π * r² * n")
multiplication_3 = Multiplication(A=number_9, B=number_10)
subtraction = Subtraction(A=multiplication_3, B=expression_6)
division_5 = Division(A=expression_6, B=multiplication_3)
multiplication_4 = Multiplication(A=subtraction, B=number_12)
subtraction_2 = Subtraction(A=1, B=division_5)
multiplication_5 = Multiplication(A=division_5, B=100)
division_6 = Division(A=number_9, B=number_10)
division_7 = Division(A=subtraction, B=1000000)
division_8 = Division(A=multiplication_4, B=1000000000)
division_9 = Division(A=multiplication_3, B=1000000)
round_to_decimal_place = RoundToDecimalPlace(NumberX=division_7, DecimalPlace=3, RoundType=0)  # -> Rounded, Difference
round_to_decimal_place_2 = RoundToDecimalPlace(NumberX=division_8, DecimalPlace=3, RoundType=0)  # -> Rounded, Difference
round_to_decimal_place_3 = RoundToDecimalPlace(NumberX=division_9, DecimalPlace=3, RoundType=0)  # -> Rounded, Difference
round_to_decimal_place_4 = RoundToDecimalPlace(NumberX=division_6, DecimalPlace=2, RoundType=0)  # -> Rounded, Difference
round_to_decimal_place_5 = RoundToDecimalPlace(NumberX=multiplication_5, DecimalPlace=2, RoundType=0)  # -> Rounded, Difference
round_to_decimal_place_6 = RoundToDecimalPlace(NumberX=expression_5, DecimalPlace=3, RoundType=0)  # -> Rounded, Difference
actual_volumn = Number(round_to_decimal_place_2.Rounded)
actual_area = Number(round_to_decimal_place.Rounded)
area = Number(round_to_decimal_place_3.Rounded)
aspect_ratio = Number(round_to_decimal_place_4.Rounded)
surface_area = Number(round_to_decimal_place_6.Rounded)
opening_ratio = Number(round_to_decimal_place_5.Rounded)
actual_volumn_m3 = Panel(actual_volumn)
actual_area_m2 = Panel(actual_area)
surface_area_m2 = Panel(surface_area)
opening_ratio_2 = Panel(opening_ratio)
aspect_ratio_2 = Panel(aspect_ratio)
dimension_list = Panel("""Length 1
Length 2
Area
Actual Area
Actual Volumn
Surface Area
Aspect Ratio
Opening Ratio""")
graft_tree_3 = GraftTree(Tree=dimension_list, IncludeEmptyLists=True, IncludeNullItems=True)
entwine = Entwine(
    Branch00=number_9,
    Branch01=number_10,
    Branch02=area,
    Branch03=actual_area_m2,
    Branch04=actual_volumn_m3,
    Branch05=surface_area_m2,
    Branch06=aspect_ratio_2,
    Branch07=opening_ratio_2,
    FlattenInputs=True)
merge = Merge(Data1=graft_tree_3, Data2=graft_tree, Data3=entwine)

dimension = Data(merge)
stream_filter_13 = StreamFilter(Gate=dimensions_3, Stream1=dimension)

dimension_2 = Data(stream_filter_13)
panel_3 = Panel(dimension_2)
dimension_3 = ClusterOutput(dimension_2)

# ----
# 3D model
number_13 = Number(panel_thickness_2)
number_14 = Number(hole_radius_2)
curve_3 = Curve(curve)
plane_4 = Plane(evaluate_surface.Point)
circle = Circle(Plane=plane_4, Radius=number_14)  # -> simplify(Circle)
unit_z = UnitZ(Factor=number_13)

list_item_3 = ListItem(List=circle, Index=0, Wrap=True)
insert_items = InsertItems(List=circle, Item=graft(curve_3), Indices="0", Wrap=True)  # -> simplify(List)

boundary_surfaces_3 = BoundarySurfaces(Edges=insert_items)
extrude = Extrude(Base=boundary_surfaces_3, Direction=unit_z)
model = Brep(extrude)

model_2 = ClusterOutput(model)

# ----
# Shop Drawing
curve_4 = Curve(stream_filter_2)
plane_5 = Plane(stream_filter)
number_slider = Slider(10, range=0..100)
circle_2 = Circle(Plane=PlaneXY(0, 0, 0), Radius=number_14)
evaluate_curve = EvaluateCurve(Curve=reparameterize(list_item_3), Parameter="0.125")  # -> Point, Tangent, Angle
construct_point = ConstructPoint(XCoordinate=0, YCoordinate=expr("x*-1", number_slider), ZCoordinate=0)
construct_point_2 = ConstructPoint(XCoordinate=0, YCoordinate=number_slider, ZCoordinate=0)
explode = Explode(Curve=curve_4, Recursive=True)  # -> Segments, Vertices
define_linear_dimension = DefineLinearDimension(Point1=evaluate_curve.Point, Point2=list_item_3, Offset=0, DimensionStyle="Default")
line = Line(StartPoint=construct_point, EndPoint=construct_point_2)
rotate = Rotate(Geometry=line, Angle=degrees(90), Plane=PlaneXY(0, 0, 0))  # -> Geometry, Transform
end_points = EndPoints(Curve=explode.Segments)  # -> Start, End
merge_2 = Merge(Data1=line, Data2=rotate.Geometry, Data3=circle_2)
define_linear_dimension_2 = DefineLinearDimension(Point1=end_points.End, Point2=end_points.Start, Offset=Slider(50, range=0..1000), DimensionStyle="Default")
group = Group(Objects=merge_2)
orient = Orient(Geometry=group, Source=PlaneXY(0, 0, 0), Target=plane_5)  # -> Geometry, Transform
merge_3 = Merge(
    Data1=simplify(curve_4),
    Data2=simplify(define_linear_dimension_2),
    Data3=simplify(orient.Geometry),
    Data4=simplify(define_linear_dimension))  # -> flatten(Result)
boolean_2 = Boolean(shop_drawing_3)
group_2 = Group(Objects=merge_3)

drawings = Geometry(group_2)
stream_filter_14 = StreamFilter(Gate=shop_drawing_3, Stream1=drawings)

drawings_2 = Geometry(stream_filter_14)
bake_objects = BakeObjects(Geometry=drawings_2, Bake=boolean_2)
drawings_3 = ClusterOutput(drawings_2)

# ----
# Performance
# 石膏板  = 0
# 矽酸鈣板 = 1
# 木絲板  = 2
# 水泥板  = 3
integer_10 = Integer(stream_filter_8)
flexural_strength_kgf_cm2 = Panel("""30
50
80
60""")
density_kg_m3 = Panel("""750
850
1200
1400""")
compressive_strength_kgf_cm2 = Panel("""60
80
160
150""")
heat_transfer_coefficient_w_m_k = Panel("""0.17
0.31
0.18
1.2""")
absorption_coefficient = Panel("""0.5
0.8
0.9
0.7""")
aspect_ratio_3 = Number(aspect_ratio)
number_15 = Number(flexural_strength_kgf_cm2)
number_16 = Number(absorption_coefficient)
number_17 = Number(heat_transfer_coefficient_w_m_k)
_1_opening_ratio = Number(subtraction_2)
actual_volumn_2 = Number(actual_volumn)
number_18 = Number(density_kg_m3)
number_19 = Number(compressive_strength_kgf_cm2)
list_item_4 = ListItem(List=number_18, Index=integer_10, Wrap=True)
list_item_5 = ListItem(List=number_19, Index=integer_10, Wrap=True)
list_item_6 = ListItem(List=number_15, Index=integer_10, Wrap=True)
list_item_7 = ListItem(List=number_16, Index=integer_10, Wrap=True)
list_item_8 = ListItem(List=number_17, Index=integer_10, Wrap=True)
expression_7 = Expression(D=list_item_4, V=actual_volumn_2, Expression="D * V")
multiplication_6 = Multiplication(A=list_item_8, B=_1_opening_ratio)
multiplication_7 = Multiplication(A=list_item_7, B=_1_opening_ratio)
multiplication_8 = Multiplication(A=list_item_6, B=aspect_ratio_3)
round_to_decimal_place_7 = RoundToDecimalPlace(NumberX=expression_7, DecimalPlace=2, RoundType=0)  # -> Rounded, Difference
number_20 = Number(multiplication_8)
number_21 = Number(multiplication_7)
number_22 = Number(list_item_5)
number_23 = Number(multiplication_6)
performance_list = Panel("""Density
Weight
Compressive Strength
Flexural Strength
Absorption Coefficient
Heat Transfer Coefficient
Cost""")
graft_tree_4 = GraftTree(Tree=performance_list, IncludeEmptyLists=True, IncludeNullItems=True)

number_24 = Number(round_to_decimal_place_7.Rounded)
number_25 = Number(list_item_4)

entwine_2 = Entwine(
    Branch00=number_25,
    Branch01=number_24,
    Branch02=number_22,
    Branch03=number_20,
    Branch04=number_21,
    Branch05=number_23,
    Branch06=cost,
    FlattenInputs=True)
merge_4 = Merge(Data1=graft_tree_4, Data2=graft_tree_2, Data3=entwine_2)

performance_4 = Data(merge_4)
stream_filter_15 = StreamFilter(Gate=performance_3, Stream1=performance_4)
clean_tree = CleanTree(RemoveNulls=True, RemoveInvalid=True, RemoveEmpty=True, Tree=stream_filter_15)

performance_5 = Data(clean_tree)
performance_6 = ClusterOutput(performance_5)
panel_4 = Panel(performance_5)
